# Grasshopper definition Monkey.gh (Grasshopper 1.0.7)
# plug-ins: Monkey, Human, Robots

half_list = MK_HalfList()  # -> first_half, mid, second_half; inputs l: list
# ---------- half_list: Python ----------
if not l:
    pass
else:
    length = len(l)
    mid_idx = length//2

    first_half = l[:mid_idx]
    mid = l[mid_idx]
    second_half = l[mid_idx+1:]
# ---------- end half_list ----------
renum = MK_ReNum()  # -> out
# ---------- renum: Python ----------
__author__ = "zzk"
__version__ = "2022.02.20"

import rhinoscriptsyntax as rs

if num == None:
    num = 0
if len == None:
    len = 1
out = "%0*d" % (len,num,)
# ---------- end renum ----------
replace_str = MK_ReplaceString()  # -> out; inputs lst: list
# ---------- replace_str: Python ----------
__author__ = "zzk"
__version__ = "2022.05.16"

import rhinoscriptsyntax as rs

out = []
if str is None:
    str = ''

for i in lst:
    rename = i.replace(key,str)
    out.append(rename)
# ---------- end replace_str ----------
culldup = MK_CullDuplicateList()  # -> out; inputs lst: list
# ---------- culldup: Python ----------
__author__ = "zzk"
__version__ = "2022.05.16"

import rhinoscriptsyntax as rs

out = list(dict.fromkeys(lst))
# ---------- end culldup ----------
randint = MK_Randint()  # -> N
# ---------- randint: Python ----------
__author__ = "zzk"
__version__ = "2022.02.25"

import rhinoscriptsyntax as rs
import random

random.seed(Sd)

if mn == None:
    mn = 0
if mx == None:
    mx  = mn

N = random.randint(mn,mx)
# ---------- end randint ----------
first_last = MK_FirstLast()  # -> first, mid, last; inputs L: list, n: Int32
# ---------- first_last: Python ----------
if not L:
    L = [0]
if not n:
    n = 0
mid = L[1+n:-1-n]

first = L[0+n]
last = L[-1-n]
# ---------- end first_last ----------
cullnull = CullNull()
crv = Curve([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])
list = ValueList({"Autodesk FBX (.fbx)": ".fbx", "Wavefront OBJ (.obj)": ".obj", "Rhino 3D Model (.3dm)": ".3dm", "Stereolithography (.stl)": ".stl", "3D Studio (.3ds)": ".3ds", "Collada (.dae)": ".dae"}, selected="Autodesk FBX (.fbx)")
loft = Loft(Curves=crv, Options={Adjust=False, Closed=False, LoftEnds=0, LoftSimp=0, LoftType=0, Rebuild=10, Refit=0.01})
pt = Point(Point(-7.147788484, -23.50705651, 0))
crv_2 = Curve(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)
crv_3 = Curve([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])
list_2 = FlagFields({"Shoulder": 1, "Elbow": 2, "Wrist": 4}, selected=[])
crvcontain = CurvesContainment(Curves=crv_3)  # -> InteriorCurves, ExteriorCurves
dla = DLACrawl(
    Geo=loft,
    Point=pt,
    AttractorCurve=crv_2,
    SimulationAttribute="{ \"interval\": 10, \"maxStep\": 200 }",
    Scale=1,
    AttractorWeight=0.1)
path = CreatePath(FileExtension=list)
number_slider = Slider(0, range=0..100)
target = CreateTarget(RobConf=list_2, IsCartesian=True)
test = Test(Absolute=True)
crv_4 = Curve(crvcontain.InteriorCurves)
crv_5 = Curve(crvcontain.ExteriorCurves)
series = Series(Start=0, Step=1, Count=10)
listseg = ListSegment(Number=1, Mode="Half")  # -> FirstNItems, MiddleItems, LastNItems
visualizer = DLAVisualzier(DLALines=dla)  # -> Parameters, Thickness
sortbydir = SortByDirections(crv=[<geometry referenced from the Rhino model> x698])  # -> horizontal_2, vertical_2, other
gradient = Gradient(
    LowerLimit=0,
    UpperLimit=1,
    Parameter=visualizer.Parameters,
    stops=[0: RGB(0, 98, 0), 0.25: RGB(81, 175, 17), 0.5: RGB(159, 198, 146), 0.75: RGB(170, 235, 41), 1: RGB(221, 255, 53)])
polymesh = PolylineMesh(PolylineSegment=0)
previewlw = CustomPreviewLineweights(Geometry=dla, Shader=gradient, Thickness=visualizer.Thickness, Absolute=False)

# ==== cluster SortByDirections: Sort list of individual crvs into horizontal and vertical
crv = ClusterInput()  # Individual curve to test verticality
crv_2 = Curve(crv)

# ---- group: Z Test
curvepoint = PointOnCurve(crv_2, parameter=1)
curvepoint_2 = PointOnCurve(crv_2, parameter=0)
pdecon = Deconstruct(Point=curvepoint_2)  # -> XComponent, YComponent, ZComponent
pdecon_2 = Deconstruct(Point=curvepoint)  # -> XComponent, YComponent, ZComponent
subtraction = Subtraction(A=pdecon.ZComponent, B=pdecon_2.ZComponent)
similar = Similarity(FirstNumber=subtraction, SecondNumber=Slider(0, range=0..100), Threshold=0.1)  # -> Similarity, AbsoluteDifference

# ----
dispatch = Dispatch(List=crv_2, DispatchPattern=similar.Similarity)  # -> ListA, ListB

# ---- group: X test
crv_3 = Curve(dispatch.ListB)
curvepoint_3 = PointOnCurve(crv_3, parameter=1)
curvepoint_4 = PointOnCurve(crv_3, parameter=0)
pdecon_3 = Deconstruct(Point=curvepoint_3)  # -> XComponent, YComponent, ZComponent
pdecon_4 = Deconstruct(Point=curvepoint_4)  # -> XComponent, YComponent, ZComponent
similar_2 = Similarity(FirstNumber=pdecon_4.XComponent, SecondNumber=pdecon_3.XComponent, Threshold=0.1)  # -> Similarity, AbsoluteDifference
dispatch_2 = Dispatch(List=crv_3, DispatchPattern=similar_2.Similarity)  # -> ListA, ListB

# ---- group: Y test
crv_4 = Curve(dispatch_2.ListA)
curvepoint_5 = PointOnCurve(crv_4, parameter=1)
curvepoint_6 = PointOnCurve(crv_4, parameter=0)
pdecon_5 = Deconstruct(Point=curvepoint_5)  # -> XComponent, YComponent, ZComponent
pdecon_6 = Deconstruct(Point=curvepoint_6)  # -> XComponent, YComponent, ZComponent
similar_3 = Similarity(FirstNumber=pdecon_6.YComponent, SecondNumber=pdecon_5.YComponent, Threshold=0.1)  # -> Similarity, AbsoluteDifference
dispatch_3 = Dispatch(List=crv_4, DispatchPattern=similar_3.Similarity)  # -> ListA, ListB

# ----
horizontal = Curve(dispatch.ListA)
vertical = Curve(dispatch_3.ListA)
else = Curve(dispatch_3.ListB)
other = ClusterOutput(else)  # Neither horizontal or vertical
vertical_2 = ClusterOutput(vertical)
horizontal_2 = ClusterOutput(horizontal)

# ==== cluster CullNull
relay = ClusterInput()
null = NullItem(Item=relay)  # -> NullFlags, InvalidFlags, Description
cull = CullPattern(List=relay, CullPattern=invert(null.NullFlags))
L = ClusterOutput(cull)
